# Grasshopper definition BSL_BABSS_AR-001_DisplayGeometry.gh (Grasshopper 1.0.7)
# plug-ins: Fologram For Grasshopper Utilities, FologramForGrasshopper

# RESEARCH PROJECT
# Bending-Active Bamboo Shell Structures:
# Methods and Guidelines for Best
# Architectural Design Practice.
# SUPPORTED BY
# Research Grants Council of the Hong Kong Special Administrative Region China (Ref. 14604618).
# REQUIRED PLUGINS
# - Fologram
# LEGEND
# User Input
data = Data(0)
# RESEARCH TEAM
# Principal Investigator: Dr Kristof Crolla
# Team Members: Garvin Goepel, Julien Klisz,
# Andreea Bunica, Abdullah Sheikh.
# Simulation Input
data_2 = Data(0)
# Procedure
# Input geometery. Entwine input.
# Scale input. Seperate input to be displayed
# in differnt colors and to visualize pipe
# thickness for curves
# © ALL RIGHTS RESERVED, 2022
# Output
data_3 = Data(0)

# ----
# Link Sliders to App
syncparams = SyncParameters(
    augmented_trigger_0_key=scale,
    augmented_trigger_1_key=number_slider,
    augmented_trigger_5_key=number_slider_2,
    componentVersion=1,
    num_augmented_triggers=9)

# ----
# Display in AR
# A. Input Geometry
# The purpose of this exercise is to get
# familiar with easy mixed reality visualization
# techniques through Fologram
crv = Curve([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])
mesh = Mesh(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)
# B. Seperate input and scale
entwine = Entwine(Branch00=crv, Branch01=mesh, FlattenInputs=True)
scale = Slider(1, range=0.01..1)
scale_2 = Scale(Geometry=entwine, Center=Point(0, 0, 0), Factor=scale)  # -> Geometry, Transform
bang = ExplodeTree(Data=scale_2.Geometry)  # -> Branch0, Branch1
number_slider = Slider(0.02624, range=0.0001..0.03)
number_slider_2 = Slider(0.005, range=0..0.01)
# C. Visualize
mpipe = MeshPipe(Polylines=bang.Branch0, NumberOfSides=4, Tolerance=number_slider_2, Radius=number_slider, Cap=False, Join=False)
sync = SyncObject(
    GM=flatten(bang.Branch1),
    AlwaysIncludeTextureCoordinates=False,
    Clickable=False,
    DefaultCurveThicknessMillimeters=4,
    DefaultGlossPercent=0,
    DefaultMaterialColor=RGB(0, 255, 217),
    DefaultSpecularPercent=0,
    Grabbable=False,
    Interactive=False,
    Occlusion=False,
    Outline=False,
    hasSerializedData=True)
sync_2 = SyncObject(
    GM=flatten(mpipe),
    AlwaysIncludeTextureCoordinates=False,
    Clickable=False,
    DefaultCurveThicknessMillimeters=4,
    DefaultGlossPercent=0,
    DefaultMaterialColor=RGB(255, 255, 255),
    DefaultSpecularPercent=0,
    Grabbable=False,
    Interactive=False,
    Occlusion=False,
    Outline=False,
    hasSerializedData=True)
