# Grasshopper definition Buildingpolygon to Building Block on Ground surface.gh (Grasshopper 1.0.7)
# plug-ins: Pufferfish

cluster = Cluster()

# ---- group: Input 2
curve = Curve([<curve referenced from the Rhino model> x38])
surface = Surface(<surface referenced from the Rhino model>)

# ---- group: Input 1
surface_2 = Surface(<surface referenced from the Rhino model>)
curve_2 = Curve([<curve referenced from the Rhino model> x157])

# ----
close_curve = CloseCurve(Curve=curve_2, CloseType=0, Bulge=0.5, Tolerance=0)  # -> Closed, ResultBoolean
close_curve_2 = CloseCurve(Curve=curve, CloseType=0, Bulge=0.5, Tolerance=0)  # -> Closed, ResultBoolean
dispatch = Dispatch(List=curve_2, DispatchPattern=close_curve.ResultBoolean)  # -> ListA, ListB
dispatch_2 = Dispatch(List=curve, DispatchPattern=close_curve_2.ResultBoolean)  # -> ListA, ListB
curve_3 = Curve(dispatch.ListB)
curve_4 = Curve(dispatch_2.ListB)
project = Project(Curve=curve_3, Brep=surface_2, Direction=Vector(0, 0, 1))  # -> flatten(Curve)
project_2 = Project(Curve=curve_4, Brep=surface, Direction=Vector(0, 0, 1))  # -> flatten(Curve)
boundary_surfaces = BoundarySurfaces(Edges=graft(curve_3))  # -> flatten(Surfaces)
unit_z = UnitZ(Factor=Slider(8, range=0..10))
boundary_surfaces_2 = BoundarySurfaces(Edges=graft(curve_4))  # -> flatten(Surfaces)
unit_z_2 = UnitZ(Factor=Slider(4, range=0..10))
explode = Explode(Curve=project, Recursive=True)  # -> Segments, Vertices
explode_2 = Explode(Curve=project_2, Recursive=True)  # -> Segments, Vertices
extrude = Extrude(Base=boundary_surfaces, Direction=unit_z)
extrude_2 = Extrude(Base=boundary_surfaces_2, Direction=unit_z_2)
deconstruct = Deconstruct(Point=explode.Vertices)  # -> XComponent, YComponent, ZComponent
deconstruct_2 = Deconstruct(Point=explode_2.Vertices)  # -> XComponent, YComponent, ZComponent
bounds = Bounds(Numbers=deconstruct.ZComponent)
bounds_2 = Bounds(Numbers=deconstruct_2.ZComponent)
panel = Panel(bounds)
panel_2 = Panel(bounds_2)
deconstruct_domain = DeconstructDomain(Domain=panel)  # -> flatten(Start), End
deconstruct_domain_2 = DeconstructDomain(Domain=panel_2)  # -> flatten(Start), End
panel_3 = Panel(deconstruct_domain.Start)
number_slider = Slider(0, range=0..100)
panel_4 = Panel(deconstruct_domain_2.Start)
number_slider_2 = Slider(0, range=0..100)
unit_z_3 = UnitZ(Factor=panel_3)
unit_z_4 = UnitZ(Factor=panel_4)

# ---- group: Output 2
move = Move(Geometry=extrude_2, Motion=unit_z_4)  # -> Geometry, Transform

# ---- group: Output 1
move_2 = Move(Geometry=extrude, Motion=unit_z_3)  # -> Geometry, Transform

# ----
merge = Merge(Data1=move_2.Geometry, Data2=move.Geometry)
surface_3 = Surface(surface_2)

split_brep = SplitBrep(Brep=merge, Cutter=surface_3)
list_item = ListItem(List=split_brep, Index=Slider(1, range=0..1), Wrap=True)
geometry = Geometry(list_item)

# ==== cluster Cluster
