# Grasshopper definition MLA Gavin  Area Calculator.gh (Grasshopper 1.0.7)

# The geometry/ies you want to take as boundary
geometry = Geometry(<curve referenced from the Rhino model>)

# ---- group: initial pt
group = Group(Objects=geometry)
bounding_box = BoundingBox(Content=group, Plane=PlaneXY(0, 0, 0))  # -> Box, Box_2
deconstruct_brep = DeconstructBrep(Brep=bounding_box.Box_2)  # -> Faces, Edges, Vertices
list_item = ListItem(List=deconstruct_brep.Vertices, Index=Slider(0, range=0..100), Wrap=True)
point = Point(list_item)

# ---- group: sqr grid
# Grid scale
number_slider = Slider(10, range=0..100)
number_slider_2 = Slider(14, range=0..100)
number_slider_3 = Slider(5, range=0..100)

# ---- group: the center point of unit sqr
division = Division(A=number_slider_3, B=Slider(2, range=0..10))
vector_xyz = VectorXYZ(XComponent=division, YComponent=division, ZComponent=0)  # -> Vector, Length

# ---- group: sqr grid
rectangular = Rectangular(Plane=point, SizeX=number_slider_3, SizeY=number_slider_3, ExtentX=number_slider, ExtentY=number_slider_2)  # -> flatten(Cells), Points

# ---- group: Count if in area
point_2 = Point(rectangular.Points)
move = Move(Geometry=point_2, Motion=vector_xyz.Vector)  # -> flatten(Geometry), Transform
point_in_curve = PointInCurve(Point=move.Geometry, Curve=graft(geometry))  # -> Relationship, Point
dispatch = Dispatch(List=move.Geometry, DispatchPattern=point_in_curve.Relationship)  # -> ListA, ListB
point_3 = Point(dispatch.ListA)
list_length = ListLength(List=point_3)

# ---- group: result display
area = Area(Geometry=geometry)  # -> Area, Centroid
square = Square(Value=number_slider_3)
multiplication = Multiplication(A=square, B=list_length)
text_tag_3d = TextTag3D(Location=area.Centroid, Text=flatten(multiplication), Size=number_slider_3, Justification=7)

# ---- group: result display / number of grid
panel = Panel(list_length)

# ---- group: result display / area of grid
panel_2 = Panel(multiplication)

# ---- group: result display / Real area result, as references
panel_3 = Panel(area.Area)
