# Grasshopper definition 点干扰.gh (Grasshopper 1.0.7)
# plug-ins: Bifocals, Pufferfish

# ---- group: This is an A3 size, change it if needed
number_slider = Slider(420, range=0..1000)
number_slider_2 = Slider(300, range=0..1000)

# ----
number_slider_3 = Slider(7, range=0..10)
division = Division(A=number_slider, B=number_slider_3)
division_2 = Division(A=number_slider_2, B=number_slider_3)
square = Square(Plane=PlaneXY(0, 0, 0), Size=number_slider_3, ExtentX=division, ExtentY=division_2)  # -> Cells, Points
area = Area(Geometry=square.Cells)  # -> Area, Centroid

# ----
# Mannul Import
# This is an internalised curve,
# rechoose your own geometry!
curve = Curve(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)

pull_point = PullPoint(Point=area.Centroid, Geometry=curve, ClosestOnly=True)  # -> ClosestPoint, Distance
bounds = Bounds(Numbers=pull_point.Distance)
construct_domain = ConstructDomain(DomainStart=Slider(0.1, range=0..0.1), DomainEnd=Slider(0.96, range=0..1))
remap_numbers = RemapNumbers(Value=pull_point.Distance, Source=bounds, Target=construct_domain)  # -> Mapped, Clipped
number_slider_4 = Slider(1, range=0..1)
subtraction = Subtraction()
graph_mapper = GraphMapper(
    remap_numbers.Mapped,
    x0=0,
    x1=1,
    y0=0,
    y1=1,
    container_name="Bezier",
    cpx=[0, 0.426868856, 0.3869306743, 1],
    cpy=[0.8128991127, 0.8238286376, 0.06090903282, 0])
scale = Scale(Geometry=square.Cells, Center=area.Centroid, Factor=graph_mapper)  # -> Geometry, Transform
point = Point(<point referenced from the Rhino model>)
point_2 = Point(Point(0, 0, 0))
move_to_point = MoveToPoint(Geometry=scale.Geometry, PointA=point_2, PointB=point)  # -> Moved, Vector, Transform
